# Grasshopper definition XshellsInterface.gh (Grasshopper 0.9.80)
# plug-ins: Python Interpreter, LinkageComponent Info

# ---- group: Input Parameters
number_slider = Slider(1, range=0.01..100)
number_slider_2 = Slider(8, range=2..200)
# Once you are happy with the topology of the initial mesh, set the mesh in the mesh component below. You can still edit it later. Set the target opening angle and the number of iterations for the solver. Turn button to True to run the solver, turn to False to stop it.
number_slider_3 = Slider(40, range=0..90)
# Set the initial number of cells per row and column as well as the acute opening angle and the edge lenght.
number_slider_4 = Slider(10, range=2..200)

number_slider_5 = Slider(50, range=0..160)
number_slider_6 = Slider(15, range=1..50)

toggle = BooleanToggle(True)

# ---- group: Set mesh from Rhino
mesh = Mesh(<mesh referenced from the Rhino model>)

# ----
demesh = DeconstructMesh(Mesh=mesh)  # -> Vertices, Faces, Colours, Normals
velistsgen = VerticesEdgesLists(Mesh=mesh)  # -> Vertices, Edges; inputs Mesh: Mesh
#   port Vertices: Mesh: Input mesh. List of vertices in format for simulation.
# ---------- velistsgen: Python ----------
"""Creates a list of vertices and edges in format for linkage simulator .
        Args: 		
    		Mesh: Input mesh.   
    Returns:
    		Vertices: List of vertices in format for simulation.
    		Edges: List of edges in format for simulation.
"""

__author__ = "minakonakovic"


import Grasshopper as gh
import Rhino as rc
import Rhino.Geometry as rg
import scriptcontext
import System.Guid
import math

# Set component name
ghenv.Component.Name = "VerticesEdgesLists"
ghenv.Component.NickName = "VEListsGen"


VertexCoord = Mesh.Vertices
Vertices = []
for index, vertex in enumerate(VertexCoord):
	Vertices.append(vertex.X)
	Vertices.append(vertex.Y)
	Vertices.append(vertex.Z)


Edges = []
for i in range(Mesh.Vertices.Count):
	neighbours = Mesh.Vertices.GetConnectedVertices(i)
	for n in neighbours:
		if n > i:
			Edges.append(i)
			Edges.append(n)
# ---------- end velistsgen ----------
gridgen = GridGenerator(Rows=number_slider_4, Columns=number_slider_2, Length=number_slider, Angle=number_slider_3)  # -> Mesh; inputs Rows: Int32, Columns: Int32
#   port Columns: Number of columns.
#   port Angle: Initial acute angle for a quad.
#   port Mesh: Quad mesh. __author__ = "minakonakovic"
# ---------- gridgen: Python ----------
"""
Generate a quad mesh grid.

    Args: 		
    		Rows: Number of row cells.
		Columns: Number of column cells.
		Length: Initial edge length.
		Angle: Acute angle of each quad.	   
    Returns:
    		Mesh: Quad mesh.
"""
__author__ = "minakonakovic"


import Grasshopper as gh
import Rhino as rc
import Rhino.Geometry as rg
import scriptcontext
import System.Guid
import math

# Set component name
ghenv.Component.Name = "GridGenerator"
ghenv.Component.NickName = "GridGen"


angleRad = Angle * math.pi / 180.0
l = Length * math.cos(angleRad / 2.0)
h = Length * math.sin(angleRad / 2.0)


x_marg = -1*Columns*l
y_marg = -1*Rows*h
ccoord = rg.Point3d(x_marg,y_marg,0)
xc = x_marg
yc = y_marg + h

mesh = rc.Geometry.Mesh()
numVert = 0
for i in range(Rows):
    mesh.Vertices.Add(xc,yc,0)
    yc += 2*h
    numVert+=1

for i in range(Columns):
    xc += l
    yc = y_marg
    mesh.Vertices.Add(xc,yc,0)
    for j in range(Rows):
        yc += 2*h
        mesh.Vertices.Add(xc,yc,0)
    yc = y_marg + h
    xc += l
    for j in range(Rows):
        mesh.Vertices.Add(xc,yc,0)
        yc += 2*h
    for j in range(Rows):
        mesh.Faces.AddFace(numVert - Rows + j, numVert + j ,numVert + Rows + j +1,numVert + j + 1 )
    numVert+= 2*Rows + 1

numVert = Rows
for j in range(Columns-1):
    for i in range(Rows-1):
        print numVert +i +1
        print numVert +i +1 + Rows
        print numVert+2*Rows +i+2
        print numVert +i +2 + Rows
        mesh.Faces.AddFace(numVert +i +1, numVert +i +1 + Rows,numVert+2*Rows + i+ 2, numVert +i +2 + Rows)
    numVert+= 2*Rows + 1

mesh.Normals.ComputeNormals()
mesh.Compact()
if scriptcontext.doc.Objects.AddMesh(mesh)!=System.Guid.Empty:
    scriptcontext.doc.Views.Redraw()
    
Mesh = mesh
# ---------- end gridgen ----------

# ---- group: Simulation Component
rodlinkage = LinkageComponent(
    Vertices=velistsgen.Vertices,
    Edges=velistsgen.Edges,
    Angle=number_slider_5,
    OpeningSteps=number_slider_6,
    SolverON=toggle)  # -> ClosedVertices, DeployedVertices

# ---- group: Bake for initial mesh!
# Bake this mesh to Rhino. Select the mesh in Rhino and turn the control points on by pressing fn+F10. You can delete the points you want, shift them, move them with Cage Edit etc. in Rhino.
startinggridmesh = Mesh(gridgen)

# ---- group: Turn Preview ON/OFF
medges = MeshEdges(Mesh=gridgen)  # -> NakedEdges, InteriorEdges, NonManifoldEdges

# ----
vertexlist = MatrixToVertexList(Matrix=rodlinkage.ClosedVertices)  # -> Vertices
# ---------- vertexlist: Python ----------
"""Converts a matrix of vertex coordinates into a vertex list for a mesh constructor.
        Args: 		
    		Matrix: Matrix 3 x n of n vertex coordinates.   
    Returns:
    		Vertices: List of vertices in format for mesh constructor.
"""

__author__ = "minakonakovic"


import Grasshopper as gh
import Rhino as rc
import Rhino.Geometry as rg
import scriptcontext
import System.Guid
import math

# Set component name
ghenv.Component.Name = "Matrix to Vertex List"
ghenv.Component.NickName = "VertexList"


Vertices = []
for i in range(Matrix.ColumnCount):
	pos = rg.Point3d(Matrix[0,i],Matrix[1,i],Matrix[2,i])
	Vertices.append(pos)
# ---------- end vertexlist ----------
vertexlist_2 = MatrixToVertexList(Matrix=rodlinkage.DeployedVertices)  # -> Vertices; same code as vertexlist
conmesh = ConstructMesh(Vertices=vertexlist, Faces=demesh.Faces)
conmesh_2 = ConstructMesh(Vertices=vertexlist_2, Faces=demesh.Faces)

# ---- group: Simulated Closed and Deployed Meshes
simulated_deployed_mesh = Mesh(conmesh_2)
simulated_closed_mesh = Mesh(conmesh)

# ---- group: Click ‘write’ button to write simulated lines into OBJ files
file_name = Panel("/tmp/simulated_deployed.obj")
file_name_2 = Panel("/tmp/simulated_closed.obj")
objlinewriter = WriteMeshAsSetOfLinesInOBJ(Mesh=simulated_closed_mesh, FileName=file_name_2, write=Button())  # inputs Mesh: Mesh
# ---------- objlinewriter: Python ----------
"""Writes a mesh into an obj file with vertices and lines, no faces.
        Args: 		
    		Mesh: Quad mesh to write edges as lines.   
		FileName: Address and name of the file to write OBJ
		Write: The file is written only after pressing the write button.
    Returns:
    		None.
"""

__author__ = "minakonakovic"


# Set component name
ghenv.Component.Name = "Write mesh as set of lines in OBJ"
ghenv.Component.NickName = "OBJLineWriter"


import Grasshopper as gh
import Rhino as rc
import Rhino.Geometry as rg
import os

if write:
	filePath = open(FileName, "w") # Open the file
	VertexCoord = Mesh.Vertices
	for index, vertex in enumerate(VertexCoord):
		filePath.write("v " + str(vertex.X) + " " + str(vertex.Y) + " " + str(vertex.Z) + "\n") # Write vertex in format "v X_coord Y_coord Z_coord"

	for i in range(Mesh.Vertices.Count):
		neighbours = Mesh.Vertices.GetConnectedVertices(i)
		for n in neighbours:
			if n > i:
				filePath.write("l " + str(i+1) + "  " + str(n+1) + "\n") # Write lines

	filePath.close() # Close the file
else:
	msg = "Click 'write' button to write the file."
	ghenv.Component.AddRuntimeMessage(gh.Kernel.GH_RuntimeMessageLevel.Warning, msg)
# ---------- end objlinewriter ----------
objlinewriter_2 = WriteMeshAsSetOfLinesInOBJ(Mesh=simulated_deployed_mesh, FileName=file_name, write=Button())  # inputs Mesh: Mesh; same code as objlinewriter

# ---- group: Translating Meshes for Displaying
box_corners = BoxCorners(Box=mesh)  # -> CornerA, CornerB, CornerC, CornerD, CornerE, CornerF, CornerG, CornerH
ln = Line(StartPoint=box_corners.CornerA, EndPoint=box_corners.CornerD)
unit = UnitVector(Vector=Vector(-0.00215671497, 0.9924045965, 0))
len = Length(Curve=ln)
multiplication = Multiplication(A=len, B=2)
multiplication_2 = Multiplication(A=len, B=4)
amp = Amplitude(Vector=unit, Amplitude=multiplication)
amp_2 = Amplitude(Vector=unit, Amplitude=multiplication_2)
move = Move(Geometry=simulated_closed_mesh, Motion=amp)  # -> Geometry, Transform
move_2 = Move(Geometry=simulated_deployed_mesh, Motion=amp_2)  # -> Geometry, Transform

# ----
simulated_deployed_mesh_for_display = Mesh(move.Geometry)
simulated_deployed_mesh_for_display_2 = Mesh(move_2.Geometry)

# ---- group: Turn Preview ON/OFF
medges_2 = MeshEdges(Mesh=move.Geometry)  # -> NakedEdges, InteriorEdges, NonManifoldEdges

medges_3 = MeshEdges(Mesh=move_2.Geometry)  # -> NakedEdges, InteriorEdges, NonManifoldEdges
