# Grasshopper definition test_linkage_initialization.gh (Grasshopper 0.9.80)
# plug-ins: Python Interpreter, LinkageComponent Info

python = PythonScript()  # -> b, a
# ---------- python: Python ----------
#vertex coordinates
b= [-0.039153, -0.157135, 0.000000, -0.039153,  0.157135, 0.000000, 0.000130,  0.000000, 0.000000, 0.039414, -0.157135, 0.000000, 0.039414,  0.157135, 0.000000]

#edge ids
a = [0,2,2,1,3,2,2,4]
# ---------- end python ----------
rodlinkage = LinkageComponent(Vertices=python.b, Edges=python.a, Angle=Slider(50, range=0..150))  # -> ClosedVertices, DeployedVertices
